# Grasshopper definition D-Calculation_BlockShape.gh (Grasshopper 1.0.8)
# plug-ins: Heteroptera, Pufferfish, Anemone, Dodo, LunchBox, Pancake, eleFront

# ----
# Block shape and volume calculations
# Developed by: Jessica Ka Yi Chiu
# 
# 1. User inputs
# 2. Import OBJ
# 3. Deteremine block shape parameters and volume
# 4. Write results to Excel
# 5. Plot results (optional)
# Colour code:
# Results
# User input
# Pre-defined values
# 1. USER INPUTS
# Step 1: DFN_Gen list and input file path
dfn_gen_id_list = Panel("""1
2
3
4
5
6
7
8
9
10
11
A
B
C
D
F
G
H
I
J
K
L
M
N
O
P
Q""")
input_obj_file_path_as_identifier = Panel("C:\Users\KYC\Downloads\DFN_gen?\DFN_gen?_blocks.obj")

# ----
# Step 2:
# Loop & write to Excel
# NB! Each iteration can take some minutes!
read_obj_calculate_export_to_excel = BooleanToggle(False)
output_file_directory = Panel("C:\Users\KYC\Downloads\DFN_BlockShape")
output_file_name_as_identifier = Panel("\DFN_?_BlockShape.xlsx")

# ----
# Step 4: Export view in Rhino to file (optional)
# Display only the relevant layer/object(s) in Rhino
export_view_to_file = Button()
rhino_command = RhinoCommand(SendCommandToggle=export_view_to_file, CommandString="_ViewCaptureToFile")

chart_10_10 = Point(Point(62.528, -19.625, 0))
chart_1_1 = Point(Point(5.475, -76.525, 0))

c_chart_10_1 = Point(Point(186.681, -0.025, 0))
a_chart_1_0 = Point(Point(130.025, -107.625, 0))
b_chart_10_0 = Point(Point(243.325, -107.625, 0))

# ----
# Plot single block on Singh et al. 2022 Chart
# Select point (Osnap) on chart in Rhino
deconstruct = Deconstruct(Point=a_chart_1_0)  # -> XComponent, YComponent, ZComponent
deconstruct_2 = Deconstruct(Point=b_chart_10_0)  # -> XComponent, YComponent, ZComponent
deconstruct_3 = Deconstruct(Point=c_chart_10_1)  # -> XComponent, YComponent, ZComponent

# ----
# Plot single block on Palmström 1995 Chart (A3-31)
# Select point (Osnap) on chart in Rhino
deconstruct_4 = Deconstruct(Point=chart_1_1)  # -> XComponent, YComponent, ZComponent
deconstruct_5 = Deconstruct(Point=chart_10_10)  # -> XComponent, YComponent, ZComponent
subtraction = Subtraction(A=deconstruct_5.XComponent, B=deconstruct_4.XComponent)
subtraction_2 = Subtraction(A=deconstruct_5.YComponent, B=deconstruct_4.YComponent)

# ---- group: Plotting points below the graphs and blocks
point_elevations_z = Panel("-20")

# ----
# Step 3: Plotting (optional)
# Open BlockShape_Playground_Results.3dm
# Specify the DFN_Gen list index for plotting
# Dot display properties
# Legend display properties
read_all_excel_sheets_for_plotting = BooleanToggle(True)
dfn_gen_list_index = Slider(26, range=0..26)
dot_display_size = Slider(0.7, range=0..1)
colour_picker = ColourPicker(PickedColour=RGBA(255, 255, 0, 15))

# ----
# Loop & write to Excel
# NB! Each iteration can take some minutes!
read_obj_calculate_export_to_excel_2 = Boolean(read_obj_calculate_export_to_excel)
# 2. IMPORT OBJ
dfn_gen_id_list_2 = Text(dfn_gen_id_list)
list_length = ListLength(List=dfn_gen_id_list_2)
loop_start = LoopStart(Repeat=list_length, Trigger=read_obj_calculate_export_to_excel_2)  # -> port, Counter, Data
panel = Panel(loop_start.Counter)

# ----
# 4. WRITE RESULTS TO EXCEL
panel_2 = Panel("""DFN_Gen
Block_ID
value_x
value_y
alpha
beta
volume_m3""")
output_directory = Text(output_file_directory)
output_file_name = Text(output_file_name_as_identifier)
concatenate = Concatenate(FragmentA=output_directory, FragmentB=output_file_name)

# ----
# Import OBJ file
input_obj_file_path = Text(input_obj_file_path_as_identifier)

# ----
# 5. PLOT RESULTS (OPTIONAL)
# with BlockShape_Playground_Results.3dm
# Read results from excel and plot on both charts
# 0 = DFN_Gen
# 1 = Block_ID
# 2 = value_x
# 3 = value_y
# 4 = alpha
# 5 = beta
# 6 = volume
read_all_excel_sheets_for_plotting_2 = Boolean(read_all_excel_sheets_for_plotting)
replace_text = ReplaceText(Text=concatenate, Find="?", Replace=dfn_gen_id_list_2, RecursiveReplace=False)
excel_reader = ExcelReader(ReadExcelData=read_all_excel_sheets_for_plotting_2, WorkbookPath=replace_text, WorksheetName="Sheet1")  # -> Exceptions, ExcelData
explode_tree = ExplodeTree(Data=excel_reader.ExcelData)  # -> Branch0, Branch1, Branch2, Branch3, Branch4, Branch5, Branch6
panel_3 = Panel(explode_tree.Branch6)
panel_4 = Panel("1")

# ----
# Create data tree and plot for each DFN_Gen
dfn_gen = Integer(dfn_gen_list_index)
legend_text = Text("DFN_Gen")
count_unique = CountUnique(Key=explode_tree.Branch0, SortIfPossible=False, LastSaveLocalization="neutral,N")  # -> KeyList, Count
list_indices = ListIndices(List=count_unique.KeyList)
duplicate_data = DuplicateData(Data=simplify(graft(list_indices)), Number=simplify(graft(count_unique.Count)), Order=True)  # -> flatten(Data)

# ---- group: Create legend
list_item = ListItem(List=dfn_gen_id_list_2, Index=dfn_gen, Wrap=invert(True))
concatenate_2 = Concatenate(FragmentA=legend_text, FragmentB=list_item)

# ---- group: Palmström
y = Number(explode_tree.Branch3)
x = Number(explode_tree.Branch2)
smaller_than = SmallerThan(FirstNumber=y, SecondNumber="10000000")  # -> SmallerThan, OrEqualTo
cull_pattern = CullPattern(List=x, CullPattern=smaller_than.OrEqualTo)
cull_pattern_2 = CullPattern(List=y, CullPattern=smaller_than.OrEqualTo)
expression = Expression(
    value_x=cull_pattern,
    x_diff_log10=subtraction,
    x_log1=deconstruct_4.XComponent,
    Expression="(log10(value_x)*x_diff_log10)+x_log1")
expression_2 = Expression(
    value_y=cull_pattern_2,
    y_diff_log10=subtraction_2,
    y_log1=deconstruct_4.YComponent,
    Expression="(log10(value_y)*y_diff_log10)+y_log1")
construct_point = ConstructPoint(XCoordinate=expression, YCoordinate=expression_2, ZCoordinate=point_elevations_z)

# ---- group: Points in Palmström plot
create_tree = CreateTree(Data=construct_point, Path=duplicate_data)
tree_branch = TreeBranch(Tree=create_tree, Path=dfn_gen, MaintainPaths=True)

# ---- group: Singh
alpha = Number(explode_tree.Branch4)
beta = Number(explode_tree.Branch5)
expression_3 = Expression(alpha=alpha, Expression="If(alpha<0,0,if(alpha>10,10,alpha))")
expression_4 = Expression(
    alpha=expression_3,
    beta=beta,
    A_x=deconstruct.XComponent,
    B_x=deconstruct_2.XComponent,
    C_x=deconstruct_3.XComponent,
    Expression="(1-beta)*((1-log10(alpha))*A_x+log10(alpha)*B_x)+beta*C_x")
expression_5 = Expression(
    alpha=expression_3,
    beta=beta,
    A_y=deconstruct.YComponent,
    B_y=deconstruct_2.YComponent,
    C_y=deconstruct_3.YComponent,
    Expression="(1-beta)*((1-log10(alpha))*A_y+log10(alpha)*B_y)+beta*C_y")
construct_point_2 = ConstructPoint(XCoordinate=expression_4, YCoordinate=expression_5, ZCoordinate=point_elevations_z)

# ---- group: Points in Singh plot
create_tree_2 = CreateTree(Data=construct_point_2, Path=duplicate_data)
tree_branch_2 = TreeBranch(Tree=create_tree_2, Path=dfn_gen, MaintainPaths=True)

# ----
dfn_gen_2 = Panel(list_item)
text_tag = TextTag(Location=Point(60.62135152, -104.1948182, 0), Text=concatenate_2, Colour="Black")
dot_display = DotDisplay(Point=[tree_branch, tree_branch_2], Colour=colour_picker, Size=dot_display_size)

# ---- group: Get DFN_GEN IDs
stream_filter = StreamFilter(Gate=read_obj_calculate_export_to_excel_2, Stream1=loop_start.Counter)
list_item_2 = ListItem(List=dfn_gen_id_list_2, Index=stream_filter, Wrap=True)

# ----
replace_text_2 = ReplaceText(Text=input_obj_file_path, Find="?", Replace=list_item_2, RecursiveReplace=False)
import_obj = ImportOBJ(File=replace_text_2, MapYtoZ=False, LastSaveLocalization="neutral,N")

# ---- group: Sort geometry based on numberical keys
list_indices_2 = ListIndices(List=import_obj)
sort_text = SortText(Keys=list_indices_2, Values=list_indices_2, Culture=127)  # -> Keys, Values

# ----
# Sort geometry based on numerical keys
replace_items = ReplaceItems(List=import_obj, Item=import_obj, Indices=sort_text.Values, Wrap=False)
object_id_sorted_blocks_obj = Geometry(replace_items)
list_indices_3 = ListIndices(List=object_id_sorted_blocks_obj)
object_id = Integer(list_indices_3)
mesh_to_polysurface = MeshToPolysurface(Mesh=object_id_sorted_blocks_obj, Triangles=False, FaceMerge=True)
is_polysurface_closed = IsPolysurfaceClosed(Polysurface=mesh_to_polysurface)
cull_pattern_3 = CullPattern(List=mesh_to_polysurface, CullPattern=is_polysurface_closed)
cull_pattern_4 = CullPattern(List=object_id, CullPattern=is_polysurface_closed)
culled_object_id = Integer(cull_pattern_4)

# ----
# 3. DETERMINE BLOCK SHAPE PARAMETERS & VOLUME
brep = Brep(cull_pattern_3)

# ----
# Determine block shape based on Palmström 1995
deconstruct_brep = DeconstructBrep(Brep=brep)  # -> Faces, Edges, Vertices
length = Length(Curve=deconstruct_brep.Edges)
count_unique_2 = CountUnique(Key=length, SortIfPossible=False, LastSaveLocalization="neutral,N")  # -> KeyList, Count
statistics = Statistics(Series=count_unique_2.KeyList)  # -> SampleMean, Median, Average, StandardDeviation, Skewness, Kurtosis, Variance
min_max = MinMax(Number=count_unique_2.KeyList)  # -> Minimum, Maximum
expression_6 = Expression(S_max=min_max.Maximum, S_min=min_max.Minimum, Expression="S_max/S_min")  # -> flatten(value_x)
expression_7 = Expression(S_mid=statistics.Median, S_min=min_max.Minimum, Expression="S_mid/S_min")  # -> flatten(value_y)
tree_statistics = TreeStatistics(Tree=brep)  # -> Paths, Length, Count
duplicate_data_2 = DuplicateData(Data=simplify(graft(tree_statistics.Paths)), Number=simplify(graft(tree_statistics.Length)), Order=True)  # -> flatten(Data)
create_tree_3 = CreateTree(Data=expression_6, Path=duplicate_data_2)
create_tree_4 = CreateTree(Data=expression_7, Path=duplicate_data_2)
value_x = Number(create_tree_3)
value_y = Number(create_tree_4)
value_y_2 = Panel(value_y)
value_x_2 = Panel(value_x)

# ----
# Determine block volume
volume = Volume(Geometry=brep)  # -> Volume, Centroid

# ----
# Determine block shape based on Singh et al. 2022
block_shape_singh_2022 = Block_shape_Singh_2022(brep=flatten(cull_pattern_3))  # -> alpha_2, beta_final_2
panel_6 = Panel(block_shape_singh_2022.beta_final_2)
panel_7 = Panel(block_shape_singh_2022.alpha_2)

# ---- group: Get DFN_GEN IDs (continued)
list_length_2 = ListLength(List=cull_pattern_3)
duplicate_data_3 = DuplicateData(Data=list_item_2, Number=list_length_2, Order=True)

# ----
replace_text_3 = ReplaceText(Text=concatenate, Find="?", Replace=list_item_2, RecursiveReplace=False)
entwine = Entwine(
    Branch00=duplicate_data_3,
    Branch01=culled_object_id,
    Branch02=value_x,
    Branch03=value_y,
    Branch04=block_shape_singh_2022.alpha_2,
    Branch05=block_shape_singh_2022.beta_final_2,
    Branch06=volume.Volume,
    FlattenInputs=True)
excel_write = ExcelWrite(
    WriteExcelData=read_obj_calculate_export_to_excel_2,
    WorkbookPath=replace_text_3,
    WorksheetName="Sheet1",
    ColumnHeadings=panel_2,
    Data=entwine,
    ClearSheet=invert(False))

loop_end = LoopEnd(port=loop_start.port, Exit=False, Data=excel_write, TimeOutVal=0, pausedState=False, state="Constant output")

# ==== cluster Block_shape_Singh_2022
brep = ClusterInput()
# Refernece:
# Singh, J. et al. (2022) ‘Modified block shape characterization method for classification of fractured rock: A python-based GUI tool’, Computers & Geosciences, 164, p. 105125. Available at: https://doi.org/10.1016/j.cageo.2022.105125.
brep_2 = Brep(brep)
# Calculation of alpha
deconstruct_brep = DeconstructBrep(Brep=brep_2)  # -> Faces, Edges, Vertices
interconnectpoints = InterconnectPoints(Pts=deconstruct_brep.Vertices)
# Calculation of beta
vector = Vector(interconnectpoints)
length = Length(Curve=interconnectpoints)

# ----
# Find longest chord
list_indices = ListIndices(List=interconnectpoints)
sort_list = SortList(Keys=length, ValuesValuesA=list_indices)  # -> reverse(Keys), reverse(ValuesValuesA)
first_last = FirstLast(List=sort_list.ValuesValuesA)  # -> FirstValue, LastValue
longest_chord_index = Integer(first_last.FirstValue)
list_item = ListItem(List=interconnectpoints, Index=longest_chord_index, Wrap=True)

chord_length = Number(length)
end_points = EndPoints(Curve=list_item)  # -> Start, End
amplitude = Amplitude(Vector=vector, Amplitude=chord_length)
volume = Volume(Geometry=brep_2)  # -> Volume, Centroid
area = Area(Geometry=deconstruct_brep.Faces)  # -> Area, Centroid
chord_length_2 = Number(length)
mass_addition = MassAddition(Input=area.Area)  # -> Result, PartialResults
statistics = Statistics(Series=chord_length_2)  # -> SampleMean, Median, Average, StandardDeviation, Skewness, Kurtosis, Variance
l_med = Number(statistics.Median)
l_med_2 = Number(l_med)
larger_than = LargerThan(FirstNumber=chord_length, SecondNumber=l_med_2)  # -> LargerThan, OrEqualTo

# ---- group: Remove longest chord from the lsit
replace_items = ReplaceItems(List=larger_than.OrEqualTo, Item="False", Indices=longest_chord_index, Wrap=False)

# ---- group: Chords longer than median
cull_pattern = CullPattern(List=interconnectpoints, CullPattern=larger_than.OrEqualTo)

# ---- group: Group A
curve_closest_point = CurveClosestPoint(Point=end_points.Start, Curve=cull_pattern)  # -> Point, Parameter, Distance
equality_within_tolerance = EqualityWithinTolerance(FirstNumber=curve_closest_point.Distance, SecondNumber="0", Tolerance=0.01)  # -> Equality, Inequality
cull_pattern_2 = CullPattern(List=cull_pattern, CullPattern=equality_within_tolerance.Equality)

# ---- group: Group B
curve_closest_point_2 = CurveClosestPoint(Point=end_points.End, Curve=cull_pattern)  # -> Point, Parameter, Distance
equality_within_tolerance_2 = EqualityWithinTolerance(FirstNumber=curve_closest_point_2.Distance, SecondNumber="0", Tolerance=0.01)  # -> Equality, Inequality
cull_pattern_3 = CullPattern(List=cull_pattern, CullPattern=equality_within_tolerance_2.Equality)

# ----
panel = Panel(mass_addition.Result)
tree_statistics = TreeStatistics(Tree=brep_2)  # -> Paths, Length, Count
expression = Expression(
    A_s=flatten(mass_addition.Result),
    l_avg=flatten(statistics.Average),
    V=flatten(volume.Volume),
    Expression="(A_s*l_avg)/(7.7*V)")

# ---- group: Calculate Group A Beta
group_a_curves = Curve(cull_pattern_2)
cross_reference = CrossReference(ListListA=group_a_curves, ListListB=group_a_curves, CrossMode=2)  # -> ListListA, ListListB
angle = Angle(VectorA=cross_reference.ListListA, VectorB=cross_reference.ListListB)  # -> Angle, Reflex
expression_2 = Expression(angle=angle.Angle, Expression="(cos(angle))²")
min_max = MinMax(Number=expression_2)  # -> Minimum, Maximum
smallest_beta_groupa = Number(min_max.Minimum)

# ----
list_item_2 = ListItem(List=amplitude, Index=longest_chord_index, Wrap=True)

# ---- group: Calculate Group B Beta
group_b_curves = Curve(cull_pattern_3)
cross_reference_2 = CrossReference(ListListA=group_b_curves, ListListB=group_b_curves, CrossMode=2)  # -> ListListA, ListListB
angle_2 = Angle(VectorA=cross_reference_2.ListListA, VectorB=cross_reference_2.ListListB)  # -> Angle, Reflex
expression_3 = Expression(angle=angle_2.Angle, Expression="(cos(angle))²")
min_max_2 = MinMax(Number=expression_3)  # -> Minimum, Maximum
smallest_beta_groupb = Number(min_max_2.Minimum)

# ----
duplicate_data = DuplicateData(Data=simplify(graft(tree_statistics.Paths)), Number=simplify(graft(tree_statistics.Length)), Order=True)  # -> flatten(Data)
longest_chord_vector = Vector(list_item_2)
create_tree = CreateTree(Data=expression, Path=duplicate_data)
alpha = Number(create_tree)
alpha_2 = ClusterOutput(alpha)
expression_4 = Expression(
    Beta_1=flatten(smallest_beta_groupa),
    Beta_2=flatten(smallest_beta_groupb),
    Expression="(2*Beta_1*Beta_2)/(Beta_1+Beta_2)")
create_tree_2 = CreateTree(Data=expression_4, Path=duplicate_data)
beta_final = Number(create_tree_2)
beta_final_2 = ClusterOutput(beta_final)
